# Grasshopper definition Generative Thinking.gh (Grasshopper 1.0.7)

hexagonal = Hexagonal(Plane=PlaneXY(0, 0, 0), Size=2, ExtentX=5, ExtentY=5)  # -> flatten(Cells), Points
curve = Curve(hexagonal.Cells)
deconstruct_brep = DeconstructBrep(Brep=curve)  # -> Faces, Edges, Vertices
create_set = CreateSet(List=flatten(deconstruct_brep.Vertices))  # -> Set, Map
point = Point(create_set.Set)
circle = Circle(Plane=point, Radius=1)  # -> simplify(Circle)

number_slider = Slider(0.46, range=0..1)  # disabled
number_slider_2 = Slider(0.46, range=0..1)  # disabled
line = Line(Line((0, 0, 0), (5, 5, 0)))  # disabled
square = Square(Plane=PlaneXY(0, 0, 0), Size=1, ExtentX=5, ExtentY=5)  # -> flatten(Cells), Points; disabled
line_2 = Line(Line((0, 0, 0), (5, 5, 0)))  # disabled
square_2 = Square(Plane=PlaneXY(0, 0, 0), Size=1, ExtentX=5, ExtentY=5)  # -> flatten(Cells), Points; disabled
evaluate_curve = EvaluateCurve(Curve=reparameterize(line), Parameter=number_slider)  # -> Point, Tangent, Angle; disabled
evaluate_curve_2 = EvaluateCurve(Curve=reparameterize(line_2), Parameter=number_slider_2)  # -> Point, Tangent, Angle; disabled
square_3 = Square(Plane=PlaneXY(0, 0, 0), Size=1, ExtentX=5, ExtentY=5)  # -> flatten(Cells), Points; disabled
square_4 = Square(Plane=PlaneXY(0, 0, 0), Size=1, ExtentX=5, ExtentY=5)  # -> flatten(Cells), Points; disabled
square_5 = Square(Plane=PlaneXY(0, 0, 0), Size=1, ExtentX=5, ExtentY=5)  # -> flatten(Cells), Points; disabled
square_6 = Square(Plane=PlaneXY(0, 0, 0), Size=1, ExtentX=5, ExtentY=5)  # -> flatten(Cells), Points; disabled
square_7 = Square(Plane=PlaneXY(0, 0, 0), Size=1, ExtentX=5, ExtentY=5)  # -> flatten(Cells), Points; disabled
curve_2 = Curve(square.Cells)  # disabled
area = Area(Geometry=curve_2)  # -> Area, Centroid; disabled
pull_point = PullPoint(Point=area.Centroid, Geometry=evaluate_curve.Point, ClosestOnly=True)  # -> ClosestPoint, Distance; disabled
list_length = ListLength(List=square_4.Cells)  # -> simplify(Length); disabled
list_length_2 = ListLength(List=square_5.Cells)  # -> simplify(Length); disabled
curve_3 = Curve(square_2.Cells)  # disabled
area_2 = Area(Geometry=curve_3)  # -> Area, Centroid; disabled
pull_point_2 = PullPoint(Point=area_2.Centroid, Geometry=evaluate_curve_2.Point, ClosestOnly=True)  # -> ClosestPoint, Distance; disabled
area_3 = Area(Geometry=circle)  # -> Area, Centroid

line_3 = Line(Line((-0.9970175296, -1.736059955, 0), (13.00114505, 15.59108816, 0)))
evaluate_curve_3 = EvaluateCurve(Curve=reparameterize(line_3), Parameter=Slider(0.499, range=0..1))  # -> Point, Tangent, Angle
pull_point_3 = PullPoint(Point=area_3.Centroid, Geometry=evaluate_curve_3.Point, ClosestOnly=True)  # -> ClosestPoint, Distance
bounds = Bounds(Numbers=pull_point_3.Distance)
remap_numbers = RemapNumbers(Value=pull_point_3.Distance, Source=bounds, Target="0.3 to 0.9")  # -> Mapped, Clipped

curve_4 = Curve(square_3.Cells)  # disabled
curve_5 = Curve(square_4.Cells)  # disabled
curve_6 = Curve(square_5.Cells)  # disabled
list_length_3 = ListLength(List=square_6.Cells)  # -> simplify(Length); disabled
curve_7 = Curve(square_6.Cells)  # disabled
panel = Panel("0.1 to 0.9")  # disabled
bounds_2 = Bounds(Numbers=pull_point.Distance)  # disabled
panel_2 = Panel("0.1 to 0.9")  # disabled
area_4 = Area(Geometry=curve_5)  # -> Area, Centroid; disabled
bounds_3 = Bounds(Numbers=pull_point_2.Distance)  # disabled
area_5 = Area(Geometry=curve_6)  # -> Area, Centroid; disabled
random = Random(Range=Domain(0, 1), Number=list_length, Seed=2)  # -> simplify(Random); disabled
random_2 = Random(Range=Domain(0, 1), Number=list_length_2, Seed=2)  # -> simplify(Random); disabled
curve_8 = Curve(square_7.Cells)  # disabled
number_slider_3 = Slider(0.25, range=0..1)  # disabled
param_viewer = ParamViewer(curve_5)  # disabled
param_viewer_2 = ParamViewer(curve_6)  # disabled
deconstruct_brep_2 = DeconstructBrep(Brep=curve_4)  # -> Faces, Edges, Vertices; disabled
list_length_4 = ListLength(List=flatten(deconstruct_brep_2.Vertices))  # disabled
random_3 = Random(Range=Domain(0, 1), Number=list_length_4, Seed=2)  # -> simplify(graft(Random)); disabled
curve_9 = Curve(<curve referenced from the Rhino model>)  # disabled
deconstruct_brep_3 = DeconstructBrep(Brep=curve_7)  # -> Faces, Edges, Vertices; disabled
random_4 = Random(Range=Domain(0, 1), Number=list_length_3, Seed=2)  # -> simplify(Random); disabled
area_6 = Area(Geometry=curve_8)  # -> Area, Centroid; disabled
deconstruct_brep_4 = DeconstructBrep(Brep=curve_2)  # -> Faces, Edges, Vertices; disabled
remap_numbers_2 = RemapNumbers(Value=pull_point.Distance, Source=bounds_2, Target=panel)  # -> Mapped, Clipped; disabled
deconstruct_brep_5 = DeconstructBrep(Brep=curve_3)  # -> Faces, Edges, Vertices; disabled
deconstruct_brep_6 = DeconstructBrep(Brep=curve_8)  # -> Faces, Edges, Vertices; disabled
remap_numbers_3 = RemapNumbers(Value=pull_point_2.Distance, Source=bounds_3, Target=panel_2)  # -> Mapped, Clipped; disabled
path_mapper = PathMapper(random_3, source="{A}", target="{A\4}")  # disabled
param_viewer_3 = ParamViewer(random)  # disabled
param_viewer_4 = ParamViewer(random_2)  # disabled
curve_closest_point = CurveClosestPoint(Point=area_6.Centroid, Curve=reparameterize(curve_9))  # -> Point, Parameter, Distance; disabled
param_viewer_5 = ParamViewer(random_4)  # disabled
area_7 = Area(Geometry=deconstruct_brep_2.Faces)  # -> Area, Centroid; disabled
scale = Scale(Geometry=curve_5, Center=area_4.Centroid, Factor=random)  # -> Geometry, Transform; disabled
scale_2 = Scale(Geometry=curve_6, Center=area_5.Centroid, Factor=random_2)  # -> Geometry, Transform; disabled
evaluate_curve_4 = EvaluateCurve(Curve=reparameterize(deconstruct_brep_3.Edges), Parameter=number_slider_3)  # -> Point, Tangent, Angle; disabled
area_8 = Area(Geometry=deconstruct_brep_3.Faces)  # -> Area, Centroid; disabled
graft_tree = GraftTree(Tree=reverse(flatten(remap_numbers_2.Mapped)), IncludeEmptyLists=True, IncludeNullItems=True)  # disabled
evaluate_curve_5 = EvaluateCurve(Curve=reparameterize(deconstruct_brep_2.Edges), Parameter=path_mapper)  # -> Point, Tangent, Angle; disabled
area_9 = Area(Geometry=deconstruct_brep_4.Faces)  # -> Area, Centroid; disabled
graft_tree_2 = GraftTree(Tree=reverse(flatten(remap_numbers_3.Mapped)), IncludeEmptyLists=True, IncludeNullItems=True)  # disabled
unit_z = UnitZ(Factor=0.5)
subtraction = Subtraction(A="1", B=remap_numbers.Mapped)
area_10 = Area(Geometry=deconstruct_brep_5.Faces)  # -> Area, Centroid; disabled
area_11 = Area(Geometry=deconstruct_brep_6.Faces)  # -> Area, Centroid; disabled
graft_tree_3 = GraftTree(Tree=reverse(flatten(curve_closest_point.Parameter)), IncludeEmptyLists=True, IncludeNullItems=True)  # disabled
evaluate_curve_6 = EvaluateCurve(Curve=reparameterize(deconstruct_brep_6.Edges), Parameter=graft_tree_3)  # -> Point, Tangent, Angle; disabled
number_slider_4 = Slider(0.3, range=0..1)  # disabled
deconstruct_brep_7 = DeconstructBrep(Brep=scale_2.Geometry)  # -> Faces, Edges, Vertices; disabled
number = Number(graft_tree)  # disabled
evaluate_curve_7 = EvaluateCurve(Curve=reparameterize(deconstruct_brep_4.Edges), Parameter=number)  # -> Point, Tangent, Angle; disabled
graft_tree_4 = GraftTree(Tree=flatten(curve_5), IncludeEmptyLists=True, IncludeNullItems=True)  # disabled
graft_tree_5 = GraftTree(Tree=flatten(scale.Geometry), IncludeEmptyLists=True, IncludeNullItems=True)  # disabled
scale_3 = Scale(Geometry=circle, Center=area_3.Centroid, Factor=subtraction)  # -> Geometry, Transform
scale_4 = Scale(Geometry=circle, Center=area_3.Centroid, Factor=0.5)  # -> Geometry, Transform
line_4 = Line(StartPoint=area_7.Centroid, EndPoint=evaluate_curve_5.Point)  # disabled
line_5 = Line(StartPoint=area_8.Centroid, EndPoint=evaluate_curve_4.Point)  # disabled
number_2 = Number(graft_tree_2)  # disabled
evaluate_curve_8 = EvaluateCurve(Curve=reparameterize(deconstruct_brep_5.Edges), Parameter=number_2)  # -> Point, Tangent, Angle; disabled
unit_z_2 = UnitZ(Factor=1)
move = Move(Geometry=circle, Motion=unit_z)  # -> Geometry, Transform
line_6 = Line(StartPoint=area_9.Centroid, EndPoint=evaluate_curve_7.Point)  # disabled
interpolate = Interpolate(Vertices=deconstruct_brep_7.Vertices, Degree=3, Periodic=True, KnotStyle=1)  # -> Curve, Length, Domain; disabled
line_7 = Line(StartPoint=area_11.Centroid, EndPoint=evaluate_curve_6.Point)  # disabled
line_8 = Line(StartPoint=area_10.Centroid, EndPoint=evaluate_curve_8.Point)  # disabled
boundary_surfaces = BoundarySurfaces(Edges=[graft_tree_4, graft_tree_5])  # disabled
unit_z_3 = UnitZ(Factor=1)  # disabled
evaluate_curve_9 = EvaluateCurve(Curve=reparameterize(line_4), Parameter=path_mapper)  # -> simplify(Point), Tangent, Angle; disabled
move_2 = Move(Geometry=scale_3.Geometry, Motion=unit_z_2)  # -> Geometry, Transform
evaluate_curve_10 = EvaluateCurve(Curve=reparameterize(line_5), Parameter=number_slider_4)  # -> Point, Tangent, Angle; disabled
end_points = EndPoints(Curve=deconstruct_brep_2.Edges)  # -> simplify(Start), simplify(End); disabled
end_points_2 = EndPoints(Curve=deconstruct_brep_3.Edges)  # -> Start, End; disabled
evaluate_curve_11 = EvaluateCurve(Curve=reparameterize(line_6), Parameter=number)  # -> simplify(Point), Tangent, Angle; disabled
graft_tree_6 = GraftTree(Tree=simplify(flatten(scale_4.Geometry)), IncludeEmptyLists=True, IncludeNullItems=True)
boundary_surfaces_2 = BoundarySurfaces(Edges=interpolate.Curve)  # disabled
end_points_3 = EndPoints(Curve=deconstruct_brep_4.Edges)  # -> simplify(Start), simplify(End); disabled
evaluate_curve_12 = EvaluateCurve(Curve=reparameterize(line_8), Parameter=number_2)  # -> simplify(Point), Tangent, Angle; disabled
evaluate_curve_13 = EvaluateCurve(Curve=reparameterize(line_7), Parameter=graft_tree_3)  # -> simplify(Point), Tangent, Angle; disabled
end_points_4 = EndPoints(Curve=deconstruct_brep_5.Edges)  # -> simplify(Start), simplify(End); disabled
end_points_5 = EndPoints(Curve=deconstruct_brep_6.Edges)  # -> simplify(Start), simplify(End); disabled
graft_tree_7 = GraftTree(Tree=flatten(move.Geometry), IncludeEmptyLists=True, IncludeNullItems=True)
graft_tree_8 = GraftTree(Tree=flatten(move_2.Geometry), IncludeEmptyLists=True, IncludeNullItems=True)
extrude = Extrude(Base=boundary_surfaces, Direction=unit_z_3)  # disabled
graft_tree_9 = GraftTree(Tree=end_points.Start, IncludeEmptyLists=True, IncludeNullItems=True)  # -> simplify(Tree); disabled
graft_tree_10 = GraftTree(Tree=end_points.End, IncludeEmptyLists=True, IncludeNullItems=True)  # -> simplify(Tree); disabled
graft_tree_11 = GraftTree(Tree=evaluate_curve_9.Point, IncludeEmptyLists=True, IncludeNullItems=True)  # -> simplify(Tree); disabled
graft_tree_12 = GraftTree(Tree=end_points_2.Start, IncludeEmptyLists=True, IncludeNullItems=True)  # disabled
graft_tree_13 = GraftTree(Tree=end_points_2.End, IncludeEmptyLists=True, IncludeNullItems=True)  # disabled
graft_tree_14 = GraftTree(Tree=evaluate_curve_10.Point, IncludeEmptyLists=True, IncludeNullItems=True)  # disabled
graft_tree_15 = GraftTree(Tree=end_points_3.Start, IncludeEmptyLists=True, IncludeNullItems=True)  # -> simplify(Tree); disabled
graft_tree_16 = GraftTree(Tree=end_points_3.End, IncludeEmptyLists=True, IncludeNullItems=True)  # -> simplify(Tree); disabled
graft_tree_17 = GraftTree(Tree=evaluate_curve_11.Point, IncludeEmptyLists=True, IncludeNullItems=True)  # -> simplify(Tree); disabled
graft_tree_18 = GraftTree(Tree=end_points_4.Start, IncludeEmptyLists=True, IncludeNullItems=True)  # -> simplify(Tree); disabled
graft_tree_19 = GraftTree(Tree=end_points_5.Start, IncludeEmptyLists=True, IncludeNullItems=True)  # -> simplify(Tree); disabled
graft_tree_20 = GraftTree(Tree=end_points_4.End, IncludeEmptyLists=True, IncludeNullItems=True)  # -> simplify(Tree); disabled
graft_tree_21 = GraftTree(Tree=end_points_5.End, IncludeEmptyLists=True, IncludeNullItems=True)  # -> simplify(Tree); disabled
graft_tree_22 = GraftTree(Tree=evaluate_curve_12.Point, IncludeEmptyLists=True, IncludeNullItems=True)  # -> simplify(Tree); disabled
graft_tree_23 = GraftTree(Tree=evaluate_curve_13.Point, IncludeEmptyLists=True, IncludeNullItems=True)  # -> simplify(Tree); disabled

merge = Merge(Data1=graft_tree_6, Data2=graft_tree_8, Data3=graft_tree_7)
loft_options = LoftOptions(Closed=Toggle(True), Adjust=Toggle(True), Rebuild=Slider(0, range=0..5), Refit=0, Type=Slider(0, range=0..5))
loft = Loft(Curves=merge, Options=loft_options)

polyline = PolyLine(Vertices=[graft_tree_14, graft_tree_13, graft_tree_12], Closed=True)  # disabled
polyline_2 = PolyLine(Vertices=[graft_tree_9, graft_tree_11, graft_tree_10], Closed=True)  # disabled
polyline_3 = PolyLine(Vertices=[graft_tree_15, graft_tree_17, graft_tree_16], Closed=True)  # disabled
polyline_4 = PolyLine(Vertices=[graft_tree_18, graft_tree_22, graft_tree_20], Closed=True)  # disabled
polyline_5 = PolyLine(Vertices=[graft_tree_19, graft_tree_23, graft_tree_21], Closed=True)  # disabled
boundary_surfaces_3 = BoundarySurfaces(Edges=polyline_2)  # disabled
boundary_surfaces_4 = BoundarySurfaces(Edges=polyline_3)  # disabled
boundary_surfaces_5 = BoundarySurfaces(Edges=polyline_4)  # disabled
boundary_surfaces_6 = BoundarySurfaces(Edges=polyline_5)  # disabled
