# Grasshopper definition galapagos.gh (Grasshopper 1.0.7)

number_slider = Slider(1.11, range=1.11..2)
line = Line(Line((-18.6558656, -0.7144799593, 0), (25.1655719, -0.7144799593, 0)))
number_slider_2 = Slider(0.729, range=0..2)
curve = Curve(line)
length = Length(Curve=curve)
panel = Panel("""0
8
2
10
4
12
6""")
panel_2 = Panel("""0
1 
9
3
11
5
6""")
end_points = EndPoints(Curve=curve)  # -> Start, End
multiplication = Multiplication(A=length, B=number_slider)
unit_z = UnitZ(Factor=1)
entwine = Entwine(Branch00=panel_2, Branch01=panel, FlattenInputs=True)  # -> simplify(Result)
catenary = Catenary(PointA=end_points.Start, PointB=end_points.End, Length=multiplication, Gravity=unit_z)
list_length = ListLength(List=entwine)
unit_vector = UnitVector(Vector=catenary)
amplitude = Amplitude(Vector=unit_vector, Amplitude=Slider(0.226, range=0..1))
panel_3 = Panel("在这把上下两条线合为一组")
move = Move(Geometry=catenary, Motion=amplitude)  # -> Geometry, Transform
entwine_2 = Entwine(Branch00=catenary, Branch01=move.Geometry, FlattenInputs=True)
tree_statistics = TreeStatistics(Tree=entwine_2)  # -> Paths, simplify(graft(Length)), Count
offset_curve = OffsetCurve(Curve=entwine_2, Distance=number_slider_2, Plane=entwine_2, Corners=1)
duplicate_data = DuplicateData(Data=entwine, Number=tree_statistics.Length, Order=True)
merge = Merge(Data1=graft(entwine_2), Data2=offset_curve)  # -> simplify(Result)
panel_4 = Panel(merge)
partition_list = PartitionList(List=duplicate_data, Size=list_length)  # -> simplify(Chunks)
divide_curve = DivideCurve(Curve=merge, Count=Slider(6, range=0..10), Kinks=False)  # -> simplify(Points), Tangents, Parameters
trim_tree = TrimTree(Tree=divide_curve.Points, Depth="1")
list_item = ListItem(List=trim_tree, Index=partition_list, Wrap=True)
polyline = PolyLine(Vertices=list_item, Closed=False)
panel_5 = Panel("""0
1
2
3
4
5""")
point_list = PointList(Points=list_item, Size=Slider(0.534, range=0..1))
panel_6 = Panel("""0
1
2
3
4""")
galapagos = Galapagos(fitness=absolute, gene=[number_slider_2, number_slider])
panel_7 = Panel("""0
2
2
4
4
6""")
explode = Explode(Curve=polyline, Recursive=True)  # -> simplify(Segments), Vertices
entwine_3 = Entwine(Branch00=panel_5, Branch01=panel_6, FlattenInputs=True)
panel_8 = Panel("""1
3
3
5""")
entwine_4 = Entwine(Branch00=panel_7, Branch01=panel_8, FlattenInputs=True)
list_item_2 = ListItem(List=explode.Segments, Index=entwine_3, Wrap=True)  # -> simplify(Item)
list_item_3 = ListItem(List=list_item, Index=entwine_4, Wrap=True)
partition_list_2 = PartitionList(List=list_item_2, Size="2")
partition_list_3 = PartitionList(List=list_item_3, Size="2")  # -> simplify(Chunks)
length_2 = Length(Curve=partition_list_2)
polyline_2 = PolyLine(Vertices=partition_list_3, Closed=False)
mass_addition = MassAddition(Input=length_2)  # -> Result, PartialResults
length_3 = Length(Curve=polyline_2)
subtraction = Subtraction(A=mass_addition.Result, B=length_3)
absolute = Absolute(Value=subtraction)  # -> simplify(Result)
panel_9 = Panel(absolute)
