# Grasshopper definition truss.gh (Grasshopper 1.0.7)

curve = Curve(<curve referenced from the Rhino model>)
curve_2 = Curve(<curve referenced from the Rhino model>)
curve_3 = Curve(<curve referenced from the Rhino model>)
curve_4 = Curve(<curve referenced from the Rhino model>)
edge_surface = EdgeSurface(CurveA=curve_3, CurveB=curve, CurveC=curve_2, CurveD=curve_4)
surface = Surface(edge_surface)
divide_domain² = DivideDomain²(Domain=surface, UCount=10, VCount=10)
isotrim = Isotrim(Surface=surface, Domain=divide_domain²)
divide_surface = DivideSurface(Surface=surface, UCount=10, VCount=10)  # -> Points, Normals, Parameters
deconstruct_brep = DeconstructBrep(Brep=isotrim)  # -> Faces, Edges, Vertices
flip_matrix = FlipMatrix(Data=divide_surface.Points)
polyline = PolyLine(Vertices=flip_matrix, Closed=False)
area = Area(Geometry=deconstruct_brep.Faces)  # -> Area, Centroid
polyline_2 = PolyLine(Vertices=divide_surface.Points, Closed=False)
explode = Explode(Curve=polyline_2, Recursive=True)  # -> Segments, Vertices
surface_closest_point = SurfaceClosestPoint(Point=area.Centroid, Surface=deconstruct_brep.Faces)  # -> Point, UVPoint, Distance
explode_2 = Explode(Curve=polyline, Recursive=True)  # -> Segments, Vertices
evaluate_surface = EvaluateSurface(Surface=deconstruct_brep.Faces, Point=surface_closest_point.UVPoint)  # -> Point, Normal, UDirection, VDirection, Frame
amplitude = Amplitude(Vector=evaluate_surface.Normal, Amplitude=2)
curve_5 = Curve([explode.Segments, explode_2.Segments])
move = Move(Geometry=area.Centroid, Motion=amplitude)  # -> Geometry, Transform
point = Point(simplify(move.Geometry))
line = Line(StartPoint=move.Geometry, EndPoint=deconstruct_brep.Vertices)
path_mapper = PathMapper(point, source="{A}", target="{A\17}")
flip_matrix_2 = FlipMatrix(Data=path_mapper)
curve_6 = Curve(line)
polyline_3 = PolyLine(Vertices=path_mapper, Closed=False)
polyline_4 = PolyLine(Vertices=flip_matrix_2, Closed=False)
merge = Merge(Data1=divide_surface.Points, Data2=move.Geometry, Data3=point)
explode_3 = Explode(Curve=polyline_3, Recursive=True)  # -> Segments, Vertices
explode_4 = Explode(Curve=polyline_4, Recursive=True)  # -> Segments, Vertices
point_2 = Point(merge)
mesh_sphere = MeshSphere(Base=point_2, Radius=Slider(0.1, range=0..0.1), UCount=10, VCount=20)
curve_7 = Curve([explode_3.Segments, explode_4.Segments])
merge_2 = Merge(Data1=curve_7, Data2=curve_6, Data3=curve_5)
mesh_join = MeshJoin(Meshes=flatten(mesh_sphere))
curve_8 = Curve(merge_2)
pipe = Pipe(Curve=curve_8, Radius=Slider(0.06, range=0..0.1), Caps=0)
mesh = Mesh(mesh_join)
mesh_brep = MeshBrep(
    Brep=pipe,
    Settings={GridMaxCount=0, GridMinCount=16, JaggedSeams=False, MaxEdgeLength=0, MinEdgeLength=0.0001, MinTolerance=0, Refine=True, RefineAngle=0, RelativeTolerance=0.65, SimplePlanes=True, Tolerance=0})
mesh_join_2 = MeshJoin(Meshes=flatten(mesh_brep))
mesh_2 = Mesh(mesh_join_2)
